# Grasshopper definition Curvature_analysis.gh (Grasshopper 0.9.80)

crv = Curve(<curve referenced from the Rhino model>)
crv_2 = Curve(<curve referenced from the Rhino model>)
divide = DivideCurve(Curve=crv, Count=Slider(92, range=1..1000), Kinks=False)  # -> Points, Tangents, Parameters
curvature = Curvature(Curve=crv, Parameter=divide.Parameters)  # -> P, K, C
crvgraph = CurvatureGraph(Curve=crv_2, Density=Slider(43.489, range=0..100), Scale=Slider(111.321, range=0..300))
circle = Circle(curvature.C)
rep = ReplaceText(Text=circle, Find="Circle(R:", RecursiveReplace=False)
frame = CurveFrame(Curve=crv, Parameter=divide.Parameters)
rep_2 = ReplaceText(Text=rep, Find=" ", RecursiveReplace=False)
rep_3 = ReplaceText(Text=rep_2, Find="mm)", RecursiveReplace=False)
division = Division(A=rep_3, B=Slider(8.129, range=1..10))
concat = Concatenate(FragmentA="0.0 To ", FragmentB=division)
rectangle = Rectangle(Plane=frame, XSize=Domain(0, 0), YSize=concat, Radius=0)  # -> Rectangle, Length
explode = Explode(Curve=rectangle.Rectangle, Recursive=True)  # -> Segments, Vertices
item = ListItem(List=explode.Vertices, Index=2, Wrap=True)  # -> flatten(Item)
pline = PolyLine(Vertices=item, Closed=False)
item_2 = ListItem(List=explode.Segments, Index=1, Wrap=True)
