# Grasshopper definition diagrid_relativetreeitem_v2.gh (Grasshopper 1.0.7)

planesrf = PlaneSurface(Plane=PlaneXY(0, 0, 0), XSize=Domain(-10, 10), YSize=Domain(-10, 10))
srf = Surface(planesrf)
sdivide = DivideSurface(Surface=srf, UCount=Slider(26, range=0..100), VCount=Slider(19, range=0..100))  # -> simplify(graft(Points)), Normals, Parameters

pt = Point(sdivide.Points)
viewer = ParamViewer(pt)
tag = TextTag3D(
    Location=pt,
    Text=graft(viewer),
    Size=Slider(0.25, range=0..1),
    Colour=ColourSwatch(SwatchColor=RGB(0, 0, 0)),
    Justification=5)

panel = Panel("""{0;-1}
{-1;0}
{0;+1}
{+1;0}
{0;-1}""")
relitem = RelativeItem(Tree=sdivide.Points, Offset=panel, WrapPaths=False, WrapItems=False)  # -> ItemA, ItemB
panel_2 = Panel("""{(1,3,...);(0,2,...)}
{(0,2,...);(1,3,...)}""")
split = SplitTree(Data=relitem.ItemA, Masks=flatten(panel_2))  # -> Positive, Negative
split_2 = SplitTree(Data=relitem.ItemB, Masks=flatten(panel_2))  # -> Positive, Negative
lng = ListLength(List=panel)
split_3 = SplitTree(Data=relitem.ItemB, Masks=flatten("{(1,3,...);(0,2,...)}"))  # -> Positive, Negative
lng_2 = ListLength(List=split_2.Positive)
equals = Equality(FirstNumber=lng_2, SecondNumber=lng)  # -> Equality, Inequality
dispatch = Dispatch(List=split.Positive, DispatchPattern=equals.Equality)  # -> ListA, ListB
dispatch_2 = Dispatch(List=split_2.Positive, DispatchPattern=equals.Equality)  # -> ListA, ListB
item = ListItem(List=dispatch.ListB, Index=0, Wrap=True)
merge = Merge(Data1=item, Data2=dispatch_2.ListB)
clean = CleanTree(RemoveNulls=True, RemoveInvalid=True, RemoveEmpty=False, Tree=merge)
avr = Average(Input=clean)
srf_cp = SurfaceClosestPoint(Point=avr, Surface=srf)  # -> Point, UVPoint, Distance
evalsrf = EvaluateSurface(Surface=srf, Point=srf_cp.UVPoint)  # -> Point, Normal, UDirection, VDirection, Frame
cir = Circle(Plane=evalsrf.Frame, Radius=1)
crv_cp = CurveClosestPoint(Point=clean, Curve=cir)  # -> Point, Parameter, Distance
sort = SortList(Keys=crv_cp.Parameter, ValuesA=clean)  # -> Keys, ValuesA
pline = PolyLine(Vertices=dispatch_2.ListA, Closed=True)
# Full Diagrid with closed panels,
# so double lines.
pline_2 = PolyLine(Vertices=sort.ValuesA, Closed=True)
# Structural lines Diagrid, no panels
# no double lines.
pline_3 = PolyLine(Vertices=split_3.Positive, Closed=False)

# ---- group: Edge Panels
crv = Curve(pline_2)

# ---- group: Inner panels
crv_2 = Curve(pline)

# ---- group: Strcutural lines
crv_3 = Curve(pline_3)
