# Grasshopper definition Lesson 1.gh (Grasshopper 0.9.76)
# plug-ins: Kangaroo2 Components

pt = Point(<point referenced from the Rhino model>)
pt_2 = Point(<point referenced from the Rhino model>)
ln = Line(StartPoint=pt, EndPoint=pt_2)
len = Length(Curve=ln)
Y = UnitY(Factor="-.5")
multiplication = Multiplication(A=len, B=Slider(1.077, range=0..3))
anchor = Anchor(Point=pt, Strength=1000)
length_line = LengthLine(Line=ln, Length=multiplication, Strength=1)
load = Load(Point=[pt, pt_2], ForceVector=Y)
grab = Grab(On=True, Strength=1000, Range=3)  # -> Grab, Anchors
solver_bouncy = SolverBouncy(
    GoalObjects=[load, anchor, length_line, grab.Grab],
    Reset=Toggle(True),
    Threshold=1e-15,
    Tolerance=0.01,
    Damping=0.99,
    Iterations=1,
    On=True)  # -> I, V, O
sph = Sphere(Base=solver_bouncy.V, Radius=1)
