# Grasshopper definition Lesson 2.gh (Grasshopper 0.9.76)
# plug-ins: Kangaroo2 Components

pt = Point(<point referenced from the Rhino model>)
pt_2 = Point(<point referenced from the Rhino model>)
ln = Line(StartPoint=pt, EndPoint=pt_2)
divide = DivideCurve(Curve=ln, Count=Slider(100, range=0..100), Kinks=False)  # -> Points, Tangents, Parameters
shatter = Shatter(Curve=ln, Parameters=divide.Parameters)
len = Length(Curve=shatter)
Y = UnitY(Factor="0.5")
item = ListItem(List=divide.Points, Index=[Slider(36, range=0..100), Slider(47, range=0..100)], Wrap=True)
multiplication = Multiplication(A=len, B=Slider(1.485, range=0..3))
length_line = LengthLine(Line=shatter, Length=multiplication, Strength=1000)
load = Load(Point=divide.Points, ForceVector=Y)
anchor = Anchor(Point=[pt, pt_2, item], Strength=1000)
grab = Grab(On=True, Strength=1000, Range=3)  # -> Grab, Anchors
solver_bouncy = SolverBouncy(
    GoalObjects=[load, anchor, length_line, grab.Grab],
    Reset=Toggle(False),
    Threshold=1e-15,
    Tolerance=0.01,
    Damping=0.99,
    Iterations=10,
    On=True)  # -> I, V, O
crv = Curve(solver_bouncy.O)
len_2 = Length(Curve=crv)
clean = CleanTree(RemoveNulls=True, RemoveInvalid=True, RemoveEmpty=False, Tree=len_2)
panel = Panel(clean)
