# Grasshopper definition Lesson 3.gh (Grasshopper 0.9.76)
# plug-ins: Kangaroo2 Components

srf = Surface(<surface referenced from the Rhino model>)
pt = Point([<point referenced from the Rhino model> x5])
custom_mesh_settings = SettingsCustom(
    StitchSeams=True,
    SimplePlanes=False,
    Refine=True,
    MinCount=16,
    MaxCount=400,
    AspectRatio=20,
    MaxDistance=0,
    MaxAngle=20,
    MinEdge="1",
    MaxEdge="1")
mesh = MeshBrep(Brep=srf, Settings=custom_mesh_settings)
medges = MeshEdges(Mesh=mesh)  # -> NakedEdges, InteriorEdges, NonManifoldEdges
demesh = DeconstructMesh(Mesh=mesh)  # -> Vertices, Faces, Colours, Normals
pt_2 = Point(pt)
crv = Curve([medges.NakedEdges, medges.InteriorEdges])
pt_3 = Point(demesh.Vertices)
len = Length(Curve=crv)
Z = UnitZ(Factor="0.5")
multiplication = Multiplication(A=len, B=Slider(1.349, range=0..3))
anchor = Anchor(Point=pt_2, Strength=1000)
length_line = LengthLine(Line=crv, Length=multiplication, Strength=1000)
load = Load(Point=pt_3, ForceVector=Z)
grab = Grab(On=True, Strength=1000, Range=3)  # -> Grab, Anchors
show = Show(G=mesh)
solver_bouncy = SolverBouncy(
    GoalObjects=[load, anchor, length_line, grab.Grab, show],
    Reset=Toggle(False),
    Threshold=1e-15,
    Tolerance=0.01,
    Damping=0.99,
    Iterations=20,
    On=True)  # -> I, V, O
crv_2 = Curve(solver_bouncy.O)
mesh_2 = Mesh(solver_bouncy.O)
len_2 = Length(Curve=crv_2)
clean = CleanTree(RemoveNulls=True, RemoveInvalid=True, RemoveEmpty=False, Tree=len_2)
panel = Panel(clean)
