# Grasshopper definition Lesson 3_v2.gh (Grasshopper 1.0.7)
# plug-ins: Kangaroo2 Components

# ---- group: Input surface from Rhino
srf = Surface()

# ----
custom_mesh_settings = SettingsCustom(
    StitchSeams=True,
    SimplePlanes=False,
    Refine=True,
    MinCount=16,
    MaxCount=400,
    AspectRatio=20,
    MaxDistance=0,
    MaxAngle=20,
    MinEdge="1",
    MaxEdge="1")

# ---- group: Anchor points from Rhino (as many as you'd like)
pt = Point()

# ----
mesh = MeshBrep(Brep=srf, Settings=custom_mesh_settings)
medges = MeshEdges(Mesh=mesh)  # -> NakedEdges, InteriorEdges, NonManifoldEdges
demesh = DeconstructMesh(Mesh=mesh)  # -> Vertices, Faces, Colours, Normals

# ---- group: Picks the closest points from the mesh according the the anchor points
cp = ClosestPoint(Point=pt, Cloud=demesh.Vertices)  # -> ClosestPoint, CPIndex, Distance

# ----
crv = Curve([medges.NakedEdges, medges.InteriorEdges])
pt_2 = Point(demesh.Vertices)
len = Length(Curve=crv)
Z = UnitZ(Factor="0.8")
multiplication = Multiplication(A=len, B=Slider(1, range=0..3))

# ---- group: New Kangaroo 2 anchor component
anchor = Anchor(Point=cp.ClosestPoint, Target=pt, Strength=10000)

# ----
load = Load(Point=pt_2, ForceVector=Z)
length_line = LengthLine(Line=crv, Length=multiplication, Strength=10)
grab = Grab(On=True, Strength=1000, Range=3)  # -> Grab, Anchors
show = Show(G=mesh)
hit_to_reset_simulation = Button()
run_the_simulation = BooleanToggle(False)
solver_bouncy = SolverBouncy(
    GoalObjects=[load, length_line, grab.Grab, show, anchor],
    Reset=hit_to_reset_simulation,
    Threshold=1e-15,
    Tolerance=0.01,
    Damping=0.99,
    Iterations=20,
    On=run_the_simulation)  # -> I, V, O
crv_2 = Curve(solver_bouncy.O)
mesh_2 = Mesh(solver_bouncy.O)
len_2 = Length(Curve=crv_2)
clean = CleanTree(RemoveNulls=True, RemoveInvalid=True, RemoveEmpty=False, Tree=len_2)
panel = Panel(clean)
