# Grasshopper definition Lesson 4.gh (Grasshopper 0.9.76)
# plug-ins: Kangaroo2 Components

srf = Surface(<surface referenced from the Rhino model>)
pt = Point([<point referenced from the Rhino model> x4])
custom_mesh_settings = SettingsCustom(
    StitchSeams=True,
    SimplePlanes=False,
    Refine=True,
    MinCount=16,
    MaxCount=400,
    AspectRatio=20,
    MaxDistance=0,
    MaxAngle=20,
    MinEdge="1",
    MaxEdge="1")
mesh = MeshBrep(Brep=srf, Settings=custom_mesh_settings)
medges = MeshEdges(Mesh=mesh)  # -> NakedEdges, InteriorEdges, NonManifoldEdges
demesh = DeconstructMesh(Mesh=mesh)  # -> Vertices, Faces, Colours, Normals
number_slider = Slider(0, range=0..3)
number_slider_2 = Slider(0, range=0..3)
pt_2 = Point(pt)
crv = Curve(medges.InteriorEdges)
panel = Panel("0.5")  # disabled
pt_3 = Point(demesh.Vertices)  # disabled
crv_2 = Curve(medges.NakedEdges)
len = Length(Curve=crv)
len_2 = Length(Curve=crv_2)
Z = UnitZ(Factor=panel)  # disabled
multiplication = Multiplication(A=len, B=number_slider)
multiplication_2 = Multiplication(A=len_2, B=number_slider)
anchor = Anchor(Point=pt_2, Strength=100000)
length_line = LengthLine(Line=crv, Length=multiplication, Strength=100)
load = Load(Point=pt_3, ForceVector=Z)  # disabled
length_line_2 = LengthLine(Line=crv_2, Length=multiplication_2, Strength=Slider(1000, range=0..1000))
grab = Grab(On=True, Strength=1000, Range=3)  # -> Grab, Anchors
show = Show(G=mesh)
solver_bouncy = SolverBouncy(
    GoalObjects=[load, anchor, length_line, grab.Grab, show, length_line_2],
    Reset=Toggle(False),
    Threshold=1e-15,
    Tolerance=0.01,
    Damping=0.99,
    Iterations=20,
    On=True)  # -> I, V, O
crv_3 = Curve(solver_bouncy.O)  # disabled
mesh_2 = Mesh(solver_bouncy.O)  # disabled
len_3 = Length(Curve=crv_3)  # disabled
clean = CleanTree(RemoveNulls=True, RemoveInvalid=True, RemoveEmpty=False, Tree=len_3)  # disabled
panel_2 = Panel(clean)  # disabled
