# Grasshopper definition Lesson 5.gh (Grasshopper 0.9.76)
# plug-ins: Kangaroo2 Components

crv = Curve([<curve referenced from the Rhino model> x6])
pt = Point([<point referenced from the Rhino model> x4])
boundary = BoundarySurfaces(Edges=crv)
srf = Surface(flatten(boundary))
custom_mesh_settings = SettingsCustom(
    StitchSeams=True,
    SimplePlanes=False,
    Refine=True,
    MinCount=16,
    MaxCount=400,
    AspectRatio=20,
    MaxDistance=0,
    MaxAngle=20,
    MinEdge=".7",
    MaxEdge=".7")
mesh = MeshBrep(Brep=srf, Settings=custom_mesh_settings)
medges = MeshEdges(Mesh=mesh)  # -> NakedEdges, InteriorEdges, NonManifoldEdges
demesh = DeconstructMesh(Mesh=mesh)  # -> Vertices, Faces, Colours, Normals
join = JoinCurves(Curves=medges.NakedEdges, Preserve=False)
cp = ControlPoints(Curve=join)  # -> Points, Weights, Knots
number_slider = Slider(0, range=0..3)
number_slider_2 = Slider(0, range=0..3)
pt_2 = Point(cp.Points)
crv_2 = Curve(medges.InteriorEdges)
pt_3 = Point(demesh.Vertices)
crv_3 = Curve(medges.NakedEdges)
len = Length(Curve=crv_2)
len_2 = Length(Curve=crv_3)
Z = UnitZ(Factor="6")
multiplication = Multiplication(A=len, B=number_slider)
multiplication_2 = Multiplication(A=len_2, B=number_slider)
anchor = Anchor(Point=pt_2, Strength=100000)
length_line = LengthLine(Line=crv_2, Length=multiplication, Strength=100)
load = Load(Point=pt_3, ForceVector=Z)
length_line_2 = LengthLine(Line=crv_3, Length=multiplication_2, Strength=Slider(1000, range=0..1000))
grab = Grab(On=True, Strength=1000, Range=3)  # -> Grab, Anchors
show = Show(G=mesh)
solver_bouncy = SolverBouncy(
    GoalObjects=[load, anchor, length_line, grab.Grab, show, length_line_2],
    Reset=Toggle(False),
    Threshold=1e-15,
    Tolerance=0.01,
    Damping=0.99,
    Iterations=20,
    On=True)  # -> I, V, O
mesh_2 = Mesh(solver_bouncy.O)
crv_4 = Curve(solver_bouncy.O)  # disabled
len_3 = Length(Curve=crv_4)  # disabled
clean = CleanTree(RemoveNulls=True, RemoveInvalid=True, RemoveEmpty=False, Tree=len_3)  # disabled
panel = Panel(clean)  # disabled
