# Grasshopper definition Lesson 6.gh (Grasshopper 0.9.76)
# plug-ins: Weaverbird, Kangaroo2 Components

pt = Point([<point referenced from the Rhino model> x4])  # disabled
del = DelaunayMesh(Points=pt, Plane=PlaneXY(0, 0, 0))  # disabled
quad = Quadrangulate(Mesh=del, Angle=0.03490658504, Ratio=0.875)  # -> Mesh, Count; disabled
faceb = FaceBoundaries(Mesh=quad.Mesh)  # -> graft(Boundaries); disabled
weld = WeldMesh(Mesh=quad.Mesh, Angle=3.141592654)  # disabled
boundary = BoundarySurfaces(Edges=faceb)  # disabled
number_slider = Slider(10, range=0..10)
number_slider_2 = Slider(8, range=0..10)
area = Area(Geometry=boundary)  # -> Area, Centroid; disabled
number_slider_3 = Slider(11, range=0..100)
crv = Curve(<curve referenced from the Rhino model>)  # disabled
incurves = PointInCurves(Point=area.Centroid, Curves=crv)  # -> Relationship, Index, Point; disabled
panel = Panel(".2")  # disabled
panel_2 = Panel("1")  # disabled
cir = Circle(Plane=PlaneXY(0, 0, 0), Radius="20")
cir_2 = Circle(Plane=PlaneXY(0, 0, 0), Radius="13")
smaller = SmallerThan(FirstNumber=incurves.Relationship, SecondNumber=panel_2)  # -> SmallerThan, OrEqualTo; disabled
custom_mesh_settings = SettingsCustom(
    StitchSeams=True,
    SimplePlanes=False,
    Refine=True,
    MinCount=16,
    MaxCount=400,
    AspectRatio=20,
    MaxDistance=0,
    MaxAngle=20,
    MinEdge=panel,
    MaxEdge=panel)  # disabled
cull = CullPattern(List=boundary, CullPattern=smaller.SmallerThan)  # -> flatten(List); disabled
divide = DivideCurve(Curve=cir_2, Count=number_slider_3, Kinks=False)  # -> Points, Tangents, Parameters
divide_2 = DivideCurve(Curve=cir, Count=number_slider_3, Kinks=False)  # -> Points, Tangents, Parameters
wbtriangles = WeaverbirdsSplitTrianglesSubdivision(MeshCurves=weld, Level=30)  # disabled
join = BrepJoin(Breps=cull)  # -> Breps, Closed; disabled
mesh = MeshBrep(Brep=join.Breps, Settings=custom_mesh_settings)  # disabled
shift = ShiftList(List=divide.Points, Shift=1, Wrap=True)
shift_2 = ShiftList(List=divide_2.Points, Shift=1, Wrap=True)
pline = PolyLine(Vertices=divide_2.Points, Closed=True)
pline_2 = PolyLine(Vertices=divide.Points, Closed=True)
medges = MeshEdges(Mesh=wbtriangles)  # -> NakedEdges, InteriorEdges, NonManifoldEdges; disabled
demesh = DeconstructMesh(Mesh=wbtriangles)  # -> Vertices, Faces, Colours, Normals; disabled
boundary_2 = BoundarySurfaces(Edges=[pline, pline_2])
srf4pt = _4PointSurface(CornerA=divide_2.Points, CornerB=divide.Points, CornerC=shift, CornerD=shift_2)  # -> graft(Surface)
area_2 = Area(Geometry=srf4pt)  # -> Area, Centroid
edges = BrepEdges(Brep=srf4pt)  # -> Naked, Interior, NonManifold
cir_3 = Circle(Plane=area_2.Centroid, Radius=".6")
join_2 = JoinCurves(Curves=edges.Naked, Preserve=False)
merge = Merge(Data1=simplify(join_2), Data2=simplify(cir_3))
boundary_3 = BoundarySurfaces(Edges=merge)
custom_mesh_settings_2 = SettingsCustom(
    StitchSeams=True,
    SimplePlanes=False,
    Refine=True,
    MinCount=16,
    MaxCount=400,
    AspectRatio=20,
    MaxDistance=0,
    MaxAngle=20,
    MinEdge=".2",
    MaxEdge=".2")
join_3 = BrepJoin(Breps=flatten(boundary_3))  # -> Breps, Closed
mesh_2 = MeshBrep(Brep=join_3.Breps, Settings=custom_mesh_settings_2)
mjoin = MeshJoin(Meshes=flatten(mesh_2))
weld_2 = WeldMesh(Mesh=mjoin, Angle=3.141592654)
demesh_2 = DeconstructMesh(Mesh=weld_2)  # -> graft(Vertices), Faces, Colours, Normals
crv_cp = CurveClosestPoint(Point=demesh_2.Vertices, Curve=flatten(cir_3))  # -> Point, Parameter, Distance
sort = SortList(Keys=crv_cp.Distance)  # -> Keys, ValuesA
item = ListItem(List=sort.Keys, Index=0, Wrap=True)
smaller_2 = SmallerThan(FirstNumber=item, SecondNumber=Slider(0.013, range=0..1))  # -> SmallerThan, OrEqualTo
panel_3 = Panel("0.5")  # disabled
Z = UnitZ(Factor=panel_3)  # disabled
multiplication = Multiplication(A="3", B=smaller_2.SmallerThan)
cull_2 = CullPattern(List=demesh_2.Vertices, CullPattern=smaller_2.SmallerThan)  # -> flatten(List)
Z_2 = UnitZ(Factor=multiplication)
Z_3 = UnitZ(Factor="3")
load = Load(Point=demesh.Vertices, ForceVector=Z)  # disabled
panel_4 = Panel("60")
move = Move(Geometry=demesh_2.Vertices, Motion=Z_2)  # -> flatten(Geometry), Transform
move_2 = Move(Geometry=cull_2, Motion=Z_3)  # -> flatten(Geometry), Transform
pt_2 = Point(flatten([divide_2.Points, divide.Points, move_2.Geometry]))
anchor = Anchor(Point=pt_2, Strength=100000)
conmesh = ConstructMesh(Vertices=move.Geometry, Faces=demesh_2.Faces)
medges_2 = MeshEdges(Mesh=conmesh)  # -> NakedEdges, InteriorEdges, NonManifoldEdges
crv_2 = Curve(medges_2.InteriorEdges)
crv_3 = Curve(medges_2.NakedEdges)
show = Show(G=conmesh)
length_line = LengthLine(Line=crv_2, Length="0", Strength=1000)
length_line_2 = LengthLine(Line=crv_3, Length="0", Strength="30000")
solver = Solver(GoalObjects=[length_line, anchor, show, length_line_2], Reset=Toggle(False), Threshold=1e-15, Tolerance=0.01, On=True)  # -> I, V, O
crv_4 = Curve()  # disabled
len = Length(Curve=crv_4)  # disabled
mesh_3 = Mesh(solver.O)
clean = CleanTree(RemoveNulls=True, RemoveInvalid=True, RemoveEmpty=False, Tree=len)  # disabled
panel_6 = Panel(clean)  # disabled
