# Grasshopper definition namegenelator.gh (Grasshopper 0.9.56)

nemoto = Curve([<curve referenced from the Rhino model> x24])
boundary = BoundarySurfaces(Edges=nemoto)
vec = VectorXYZ(XComponent=0, YComponent=0, ZComponent=Slider(25, range=1..101))  # -> Vector, Length
bbox = BoundingBox(Content=boundary, Plane=PlaneXY(0, 0, 0))  # -> Box, Box_2
move = Move(Geometry=boundary, Motion=vec.Vector)  # -> Geometry, Transform
debrep = DeconstructBrep(Brep=bbox.Box)  # -> Faces, Edges, Vertices
xy = XYPlane(Origin=debrep.Vertices)
list = ValueList({"One": 0, "Two": 1, "Three": 2, "Four": 3}, selected="Four")
item = ListItem(List=xy, Index=list, Wrap=True)
scale_nu = ScaleNU(Geometry=boundary, Plane=item, ScaleX=1, ScaleY=Slider(0.833, range=0..1), ScaleZ=1)  # -> Geometry, Transform
debrep_2 = DeconstructBrep(Brep=move.Geometry)  # -> Faces, Edges, Vertices
debrep_3 = DeconstructBrep(Brep=scale_nu.Geometry)  # -> Faces, Edges, Vertices
rulesrf = RuledSurface(CurveA=debrep_3.Edges, CurveB=debrep_2.Edges)
join = BrepJoin(Breps=[rulesrf, move.Geometry, scale_nu.Geometry])  # -> Breps, Closed
