# Grasshopper definition Plus_or_minus.gh (Grasshopper 0.9.80)

number_slider = Slider(10, range=0..100)
number_slider_2 = Slider(10, range=0..100)
number_slider_3 = Slider(0.9, range=0..1)
number_slider_4 = Slider(0.8, range=0..1)
number_slider_5 = Slider(1.7, range=0.3..20)

multiplication = Multiplication(A=number_slider, B=number_slider_2)
division = Division(A=multiplication, B=-2)
pt = ConstructPoint(XCoordinate=division, YCoordinate=division, ZCoordinate=0)

sqgrid = Square(Plane=pt, Size=number_slider, ExtentX=number_slider_2, ExtentY=number_slider_2)  # -> flatten(Cells), flatten(Points)
crv = Curve(<curve referenced from the Rhino model>)
area = Area(Geometry=sqgrid.Cells)  # -> Area, Centroid
number_slider_6 = Slider(0.5, range=0.1..3)
number_slider_7 = Slider(2.5, range=0.1..3)
pt_2 = Point([sqgrid.Points, area.Centroid])

offset = Offset(Curve=crv, Distance=Slider(200, range=0..200), Plane=PlaneXY(0, 0, 0), Corners=3)
rulesrf = RuledSurface(CurveA=crv, CurveB=offset)
pull = PullPoint(Point=pt_2, Geometry=rulesrf, ClosestOnly=True)  # -> ClosestPoint, Distance
smaller = SmallerThan(FirstNumber=0.01, SecondNumber=pull.Distance)  # -> SmallerThan, OrEqualTo

neg = Negative(Value=number_slider_7)
neg_2 = Negative(Value=number_slider_6)
cull = CullPattern(List=pt_2, CullPattern=smaller.SmallerThan)
dom = ConstructDomain(DomainStart=number_slider_7, DomainEnd=neg)
dom_2 = ConstructDomain(DomainStart=number_slider_6, DomainEnd=neg_2)

pull_2 = PullPoint(Point=cull, Geometry=crv, ClosestOnly=True)  # -> ClosestPoint, Distance
bnd = Bounds(Numbers=pull_2.Distance)
dom_3 = ConstructDomain(DomainStart=Slider(0.3, range=0.1..1.1), DomainEnd=Slider(2.5, range=0.1..2.5))
remap = RemapNumbers(Value=pull_2.Distance, Source=bnd, Target=dom_3)  # -> Mapped, Clipped

panel = Panel(remap.Mapped)
neg_3 = Negative(Value=panel)
dom_4 = ConstructDomain(DomainStart=panel, DomainEnd=neg_3)
rectangle = Rectangle(Plane=cull, XSize=dom, YSize=dom_2, Radius=0)  # -> Rectangle, Length
rectangle_2 = Rectangle(Plane=cull, XSize=dom_2, YSize=dom_4, Radius=0)  # -> Rectangle, Length
fillet = Fillet(Curve=rectangle.Rectangle, Radius=0.5)
fillet_2 = Fillet(Curve=rectangle_2.Rectangle, Radius=0.5)
runion = RegionUnion(Curves=[fillet, fillet_2])

crv_2 = Curve(<curve referenced from the Rhino model>)
Z = UnitZ(Factor=Slider(3.4, range=0..10))
extr = Extrude(Base=crv_2, Direction=Z)
cap = CapHoles(Brep=extr)

Z_2 = UnitZ(Factor=Slider(5.1, range=0..10))
extr_2 = Extrude(Base=runion, Direction=Z_2)
cap_2 = CapHoles(Brep=extr_2)

sdiff = SolidDifference(BrepsA=cap, BrepsB=cap_2)
