# Grasshopper definition square.gh (Grasshopper 0.9.80)

number_slider = Slider(7.076, range=0..100)
number_slider_2 = Slider(20, range=0..100)

crv = Curve(<curve referenced from the Rhino model>)
Z = UnitZ(Factor=Slider(3.4, range=0..10))
extr = Extrude(Base=crv, Direction=Z)
cap = CapHoles(Brep=extr)

multiplication = Multiplication(A=number_slider, B=number_slider_2)
division = Division(A=multiplication, B=-2)
pt = ConstructPoint(XCoordinate=division, YCoordinate=division, ZCoordinate=0)
crv_2 = Curve(<curve referenced from the Rhino model>)
sqgrid = Square(Plane=pt, Size=number_slider, ExtentX=number_slider_2, ExtentY=number_slider_2)  # -> flatten(Cells), Points
rad = Radians(Degrees=45)
rotate = Rotate(Geometry=sqgrid.Cells, Angle=rad, Plane=PlaneXY(0, 0, 0))  # -> Geometry, Transform
area = Area(Geometry=rotate.Geometry)  # -> Area, Centroid

offset = Offset(Curve=crv_2, Distance=Slider(200, range=0..200), Plane=PlaneXY(0, 0, 0), Corners=3)
rulesrf = RuledSurface(CurveA=crv_2, CurveB=offset)
pull = PullPoint(Point=area.Centroid, Geometry=rulesrf, ClosestOnly=True)  # -> ClosestPoint, Distance
smaller = SmallerThan(FirstNumber=0.01, SecondNumber=pull.Distance)  # -> SmallerThan, OrEqualTo
cull = CullPattern(List=rotate.Geometry, CullPattern=smaller.SmallerThan)

cull_2 = CullPattern(List=area.Centroid, CullPattern=smaller.SmallerThan)
scale = Scale(Geometry=cull, Center=cull_2, Factor=Slider(0.9, range=0..1))  # -> Geometry, Transform
fillet = Fillet(Curve=scale.Geometry, Radius=Slider(1.7, range=0.3..20))

pull_2 = PullPoint(Point=cull_2, Geometry=crv_2, ClosestOnly=True)  # -> ClosestPoint, Distance
bnd = Bounds(Numbers=pull_2.Distance)
dom = ConstructDomain(DomainStart=Slider(0.2, range=0.1..1.1), DomainEnd=Slider(1, range=0.1..1.5))
remap = RemapNumbers(Value=pull_2.Distance, Source=bnd, Target=dom)  # -> Mapped, Clipped

scale_2 = Scale(Geometry=fillet, Center=cull_2, Factor=remap.Mapped)  # -> Geometry, Transform
scale_3 = Scale(Geometry=scale_2.Geometry, Center=cull_2, Factor=Slider(0.8, range=0..1))  # -> Geometry, Transform

rulesrf_2 = RuledSurface(CurveA=scale_2.Geometry, CurveB=scale_3.Geometry)
Z_2 = UnitZ(Factor=Slider(5.1, range=0..10))
extr_2 = Extrude(Base=rulesrf_2, Direction=Z_2)

sdiff = SolidDifference(BrepsA=cap, BrepsB=extr_2)
