# Grasshopper definition RefMaker.gh (Grasshopper 0.9.80)

panel = Panel("""1.srfを右クリック→set one srf
2.DIVIDEの数値を調整
3.方向を調整""")
panel_2 = Panel("joinを右クリック")

# ---- group: INPUT
list = ValueList({"X": 4, "Y": 9, "Z": 10}, selected="Z")
list_2 = ValueList({"flip": 1, "flip": -1}, selected="flip")
number_slider = Slider(0.61, range=-5..5)

# ---- group: INPUT / DIVIDE
number_slider_2 = Slider(8, range=0..100)
number_slider_3 = Slider(10, range=0..100)

# ---- group: INPUT / Base_SRF
srf = Surface(<surface referenced from the Rhino model>)

# ---- group: PROCESSIG
divide = DivideDomain²(Domain=srf, UCount=number_slider_3, VCount=number_slider_2)
multiplication = Multiplication(A=number_slider, B=list_2)
vec = VectorXYZ(XComponent=multiplication, YComponent=0, ZComponent=0)  # -> Vector, Length
subsrf = Isotrim(Surface=srf, Domain=divide)
pt2num = PointsToNumbers(Points=vec.Vector, Mask=list)  # -> flatten(Numbers)
num2pt = NumbersToPoints(Numbers=pt2num, Mask=4)
srf_2 = Surface(subsrf)
move = Move(Geometry=srf_2, Motion=num2pt)  # -> Geometry, Transform
debrep = DeconstructBrep(Brep=move.Geometry)  # -> Faces, Edges, Vertices
debrep_2 = DeconstructBrep(Brep=srf_2)  # -> Faces, Edges, Vertices
crv = Curve(debrep_2.Edges)
crv_2 = Curve(debrep.Edges)
curvepoint = PointOnCurve(crv_2, parameter=0.5)
end = EndPoints(Curve=crv)  # -> Start, End
item = ListItem(List=curvepoint, Index=0, Wrap=True)  # -> Item, Item1, Item2, Item3
item_2 = ListItem(List=end.End, Index=0, Wrap=True)  # -> Item, Item1, Item2, Item3
item_3 = ListItem(List=end.Start, Index=0, Wrap=True)  # -> Item, Item1, Item2, Item3
pt = Point(item.Item)
pt_2 = Point(item.Item1)
pt_3 = Point(item.Item2)
pt_4 = Point(item.Item3)
pt_5 = Point(item_3.Item)
pt_6 = Point(item_3.Item1)
pt_7 = Point(item_3.Item2)
pt_8 = Point(item_3.Item3)
pt_9 = Point(item_2.Item)
pt_10 = Point(item_2.Item1)
pt_11 = Point(item_2.Item2)
pt_12 = Point(item_2.Item3)
arc = Arc3Pt(PointA=pt_6, PointB=pt_2, PointC=pt_10)  # -> Arc, Plane, Radius
arc_2 = Arc3Pt(PointA=pt_8, PointB=pt_4, PointC=pt_12)  # -> Arc, Plane, Radius
arc_3 = Arc3Pt(PointA=pt_5, PointB=pt, PointC=pt_9)  # -> Arc, Plane, Radius
arc_4 = Arc3Pt(PointA=pt_7, PointB=pt_3, PointC=pt_11)  # -> Arc, Plane, Radius
netsurf = NetworkSurface(CurvesU=[arc_4.Arc, arc_3.Arc], CurvesV=[arc.Arc, arc_2.Arc], Continuity=2)

# ---- group: PROCESSIG / VECTOR
pt_13 = ConstructPoint(XCoordinate=0, YCoordinate=0, ZCoordinate=0)
ln = Line(StartPoint=pt_13, EndPoint=num2pt)
scale = Scale(Geometry=ln, Center=Point(0, 0, 0), Factor=100)  # -> Geometry, Transform
end_2 = EndPoints(Curve=scale.Geometry)  # -> Start, End
vdis = VectorDisplay(Anchor=end_2.Start, Vector=end_2.End)

# ---- group: OUTPUT
join = BrepJoin(Breps=netsurf)  # -> Breps, Closed
